vi "GW server.gvi"   [LabVIEW NXG 3.1.0]
panel controls:
  "Stop": bool
panel indicators:
  "loop iteration_2": i32
  "bytes written": i32
uses:
  NI::G Core::Error::Display Error.gvi
  NI::G Core::Error::Filter Error Codes.gvi
  NI::G Core::Error::Filter Error Code.gvi
diagram:
  Tcp Create Listener(port=6340, timeout ms=-1) -> (error out=w1, listener ID=w2)
  Tcp Wait On Listener(error in=w1, listener ID in=w2, timeout ms=-1) -> (connection ID=w3, error out=w4, listener ID out=w5)
  # Bi-Directional Exp
  w6 = 61557  # remote port
  # TCP Client Loop
  w7 = "10.187.80.45"  # address
  String To Ip Address(name=w7) -> (net address=w8)
  w9 = 61559  # local port
  Udp Open(port=w9) -> (connection ID=w10, error out=w11)  # UDP Open Connection
  while {
    Tcp Read Binary(bytes to read=100, connection ID=w3, error in=w4, mode="Immediate", timeout ms=-1) -> (connection ID out=w12, data out=w13, error out=w14)
    Udp Write Binary(address=w8, connection ID=w10, data in=w13, error in=w11, port or service name=w6, timeout ms=25000) -> (connection ID out=w15, error out=w16)
    # TCP Client Loop
    Wait(time to wait=1)
    stop if $Stop
  }
  Udp Close(connection ID=w15, error in=w16) -> (error out=w17)  # UDP Close Connection
  call "Display Error.gvi"(error in=w17)
  Tcp Close Connection(connection ID=w5, error in=w4)
  Tcp Write(connection ID=w12, data in="Q", error in=w14) -> (connection ID out=w18, error out=w19)
  Tcp Close Connection(connection ID=w18, error in=w19) -> (error out=w20)
  call "Filter Error Codes.gvi"(error in=w20, codes to clear=[62, 64, 66]) -> (error out=w21, error cleared?=w22)
  call "Display Error.gvi"(error in=w21)
  case (w22) {
    frame False { }
    frame True {
      # Client Closed
      One Button Dialog(message="The server closed the connection.")
    }
  }
  w23 = 61556  # receiver port
  Udp Open(port=w23) -> (connection ID=w24, error out=w25)  # UDP Open Connection
  while (iteration -> i1) {
    Udp Read Binary(connection ID=w24, error in=w25, max size=1400, timeout ms=-1) -> (connection ID out=w26, data out=w27, error out=w28)  # UDP Read Binary (U32 Address)
    Tcp Write Binary(connection ID=w3, data in=w27, error in=w25, timeout ms=-1) -> (bytes written=w29, error out=w30)
    $"bytes written" <- w29
    call "Filter Error Code.gvi"(code to clear=56, error in=w30) -> (error out=w31)
    Merge Errors(w31, w28) -> (error out=w32)
    $"loop iteration_2" <- i1
    stop if $Stop
  }
  Udp Close(connection ID=w26, error in=w32) -> (error out=w33)  # UDP Close Connection
  call "Display Error.gvi"(error in=w33)
