vi "Simple TCP - Server.gvi"   [LabVIEW NXG 3.1.0]
panel controls:
  "Stop": bool
panel indicators:
  "Waveform Graph": f64[]
uses:
  NI::G Core::Error::Filter Error Code.gvi
  NI::G Core::Error::Filter Error Codes.gvi
  NI::G Core::Error::Display Error.gvi
diagram:
  # The TCP Wait on Listener node generates a connection reference whenever the client connects on the specified port. Note that in this example the client has 30 seconds to connect before the server times out.
  Tcp Create Listener(port=6340, timeout ms=30000) -> (error out=w1, listener ID=w2)
  Tcp Wait On Listener(error in=w1, listener ID in=w2, timeout ms=30000) -> (connection ID=w3, error out=w4, listener ID out=w5)
  Tcp Close Connection(connection ID=w5, error in=w4) -> (error out=w6)
  # TCP Close Connection closes the connection when the user clicks Stop or an error occurs.
  # Certain error codes can occur if the client VI closes the connection. In these cases, ignore the potential errors that can occur, and instead pop up a dialog indicating that the client closed the connection.
  # The first TCP Write node specifies the amount of data being sent, and the second TCP Write node sends the data.  The TCP Read node checks to see if the client has written any data. If it has, then the client is telling the server to stop executing. Note that the timeout on the TCP Read node is '0', as the client will not always be sending data to the server. Since TCP Read will return an error 56 on a timeout, the Filter Error Code node is used to ignore the timeout error within the loop.
  while {
    # TCP Server Loop
    for (N = 50) {
      Random Number() -> (number (0 to 1)=w8)
      append w8 to w7
    }
    $"Waveform Graph" <- w7
    Flatten To Byte Array(anything=w7) -> (data bytes=w9)
    Array Size(array=w9) -> (size(s)=w10)
    Flatten To Byte Array(anything=w10) -> (data bytes=w11)
    Tcp Write Binary(connection ID=w3, data in=w11, error in=w6) -> (connection ID out=w12, error out=w13)
    Tcp Write Binary(connection ID=w12, data in=w9, error in=w13) -> (connection ID out=w14, error out=w15)
    Tcp Read Binary(bytes to read=1, connection ID=w14, error in=w15, timeout ms=0) -> (connection ID out=w16, data out=w17, error out=w18)
    Is Empty Array(array=w17) -> w19
    call "Filter Error Code.gvi"(code to clear=56, error in=w18) -> (error out=w20)
    Logical Or(not w19, w20, $Stop) -> w21
    Wait(time to wait=100)
    stop if w21
  }
  Tcp Close Connection(connection ID=w16, error in=w20) -> (error out=w22)
  call "Filter Error Codes.gvi"(codes to clear=[56, 62, 64, 66], error in=w22) -> (codes cleared=w23, error out=w24)
  call "Display Error.gvi"(error in=w24)
  Array Index(array=w23) -> (out0[_]=w25)
  case (w25) {
    frame Default { }
    frame 62, 64, 66 {
      # Client Closed
      One Button Dialog(message="The client closed the connection.")
    }
    frame 56 {
      # Timeout
      w26 = "The operation timed out. Make sure to run the client \r\nwithin 30 seconds after running the server."
      One Button Dialog(message=w26)
    }
  }
