vi "TCPClient_GW.gvi"   [LabVIEW NXG 3.1.0]
panel controls:
  "Stop": bool
panel indicators:
  "loop iteration": i32
  "loop iteration_2": i32
  "Waveform Graph": f64[]
  "error out": error
uses:
  NI::G Core::Error::Display Error.gvi
  NI::G Core::Error::Filter Error Codes.gvi
  NI::G Core::Error::Filter Error Code.gvi
diagram:
  w1 = 61558  # remote port
  w2 = "localhost"  # address
  String To Ip Address(name=w2) -> (net address=w3)
  w4 = 61556  # local port
  Udp Open(port=w4) -> (connection ID=w5, error out=w6)  # UDP Open Connection
  Udp Write Binary(address=w3, connection ID=w5, error in=w6, port or service name=w1) -> (connection ID out=w7, error out=w8)
  Udp Close(connection ID=w7, error in=w8) -> (error out=w9)  # UDP Close Connection
  call "Display Error.gvi"(error in=w9)
  # Open a TCP connection with the TCP Open Connection node. Note that the port must match the one specified in Simple TCP - Server.gvi.
  Tcp Open Connection(address="localhost", remote port or service name=6340) -> (connection ID=w10, error out=w11)
  # Use TCP Write to send a single character to the server to indicate that the client has stopped. TCP Close Connection closes the connection when the user clicks Stop or an error occurs.
  # Read the data on the specified connection. The first TCP Read node acquires the size of the data, and the second TCP
  # Read node reads the data itself if the size of the data (specified by the server) is greater than zero.
  while (iteration -> i1) {
    # TCP Client Loop
    Tcp Read Binary(bytes to read=404, connection ID=w10, error in=w11, mode="Immediate", timeout ms=-1) -> (data out=w12, error out=w13)
    Unflatten From Byte Array(data bytes=w12, type=f64[] []) -> (error out=w14, value=w15)
    $"Waveform Graph" <- w15
    $"error out" <- w14
    Wait(time to wait=100)
    Logical Or(FALSE, $Stop) -> w16
    $"loop iteration" <- i1
    stop if w16
  }
  Tcp Write(connection ID=w10, data in="Q", error in=w13) -> (connection ID out=w17, error out=w18)
  Tcp Close Connection(connection ID=w17, error in=w18) -> (error out=w19)
  call "Filter Error Codes.gvi"(error in=w19, codes to clear=[62, 64, 66]) -> (error out=w20, error cleared?=w21)
  call "Display Error.gvi"(error in=w20)
  case (w21) {
    frame False { }
    frame True {
      # Client Closed
      One Button Dialog(message="The server closed the connection.")
    }
  }
  w22 = 61557  # receiver port
  # Use the UDP Open Connection node to connect to the specified receiver port.
  Udp Open(port=w22) -> (connection ID=w23, error out=w24)  # UDP Open Connection
  # Use the UDP Read node to receive the data from the Simple UDP - Sender.gvi.
  while (iteration -> i2) {
    Udp Read Binary(connection ID=w23, error in=w24, timeout ms=-1) -> (connection ID out=w25, data out=w26, error out=w27)  # UDP Read Binary (U32 Address)
    Tcp Write Binary(connection ID=w10, data in=w26, error in=w24) -> (error out=w28)
    call "Filter Error Code.gvi"(code to clear=56, error in=w28) -> (error out=w29)
    Merge Errors(w29, w27) -> (error out=w30)
    Logical Or(FALSE, $Stop) -> w31
    $"loop iteration_2" <- i2
    stop if w31
  }
  Udp Close(connection ID=w25, error in=w30) -> (error out=w32)  # UDP Close Connection
  # UDP Close Connection closes the connection when the user clicks Stop or an error occurs.
  call "Display Error.gvi"(error in=w32)
