vi "Simple UDP - Receiver.gvi"   [LabVIEW NXG 3.1.0]
panel controls:
  "Stop": bool
panel indicators:
  "Received Data": f64[]
uses:
  NI::G Core::Error::Filter Error Code.gvi
  NI::G Core::Error::Display Error.gvi
diagram:
  w1 = 61558  # receiver port
  Udp Open(port=w1) -> (connection ID=w2, error out=w3)  # UDP Open Connection
  # Use the UDP Open Connection node to connect to the specified receiver port.
  # Use the UDP Read node to receive the data from the Simple UDP - Sender.gvi.
  while {
    Udp Read Binary(connection ID=w2, error in=w3, timeout ms=100) -> (connection ID out=w4, data out=w5, error out=w6)  # UDP Read Binary (U32 Address)
    case (w6) {
      frame Error {
        # Sender did not send data. Ignore error 56 (timeout) and keep waiting.
        call "Filter Error Code.gvi"(code to clear=56, error in=w6) -> (error out=w7)
      }
      frame No Error {
        # Sender sent data. Update the chart value.
        Unflatten From Byte Array(data bytes=w5, type=f64[] []) -> (value=w8)
        $"Received Data" <- w8
        w7 = w6
      }
    }
    Logical Or(w7, $Stop) -> w9
    stop if w9
  }
  Udp Close(connection ID=w4, error in=w7) -> (error out=w10)  # UDP Close Connection
  # UDP Close Connection closes the connection when the user clicks Stop or an error occurs.
  call "Display Error.gvi"(error in=w10)
