vi "Application Client.gvi"   [LabVIEW NXG 3.1.0]
panel controls:
  "Stop": bool
panel indicators:
  "TX data": f64[]
  "loop iteration": i32
  "RX data": f64
uses:
  NI::G Core::Error::Filter Error Code.gvi
  NI::G Core::Error::Filter Error Codes.gvi
  NI::G Core::Error::Display Error.gvi
diagram:
  # The TCP Wait on Listener node generates a connection reference whenever the client connects on the specified port. Note that in this example the client has 30 seconds to connect before the server times out.
  Tcp Open Connection(address="localhost", remote port or service name=6340) -> (connection ID=w1, error out=w2)
  # TCP Close Connection closes the connection when the user clicks Stop or an error occurs.
  # Certain error codes can occur if the client VI closes the connection. In these cases, ignore the potential errors that can occur, and instead pop up a dialog indicating that the client closed the connection.
  while {
    # TCP Server Loop
    for (N = 50) {
      Random Number() -> (number (0 to 1)=w4)
      append w4 to w3
    }
    $"TX data" <- w3
    Flatten To Byte Array(anything=w3) -> (data bytes=w5)
    Array Size(array=w5) -> (size(s)=w6)
    Flatten To Byte Array(anything=w6)
    Tcp Write Binary(connection ID=w1, data in=w5, error in=w2) -> (connection ID out=w7, error out=w8)
    call "Filter Error Code.gvi"(code to clear=56, error in=w8) -> (error out=w9)
    Logical Or(not TRUE, w9, $Stop) -> w10
    Wait(time to wait=100)
    stop if w10
  }
  Tcp Close Connection(connection ID=w7, error in=w9) -> (error out=w11)
  call "Filter Error Codes.gvi"(codes to clear=[56, 62, 64, 66], error in=w11) -> (codes cleared=w12, error out=w13)
  call "Display Error.gvi"(error in=w13)
  Array Index(array=w12) -> (out0[_]=w14)
  case (w14) {
    frame Default { }
    frame 62, 64, 66 {
      # Client Closed
      One Button Dialog(message="The client closed the connection.")
    }
    frame 56 {
      # Timeout
      w15 = "The operation timed out. Make sure to run the client \r\nwithin 30 seconds after running the server."
      One Button Dialog(message=w15)
    }
  }
  while (iteration -> i1) {
    Tcp Read Binary(bytes to read=8, connection ID=w1, error in=w2, timeout ms=-1) -> (data out=w16, error out=w17)
    Unflatten From Byte Array(data bytes=w16, error in=w17, type=f64 0) -> (value=w18)
    $"RX data" <- w18
    $"loop iteration" <- i1
    stop if $Stop
  }
