vi "GW server.gvi"   [LabVIEW NXG 3.1.0]
panel controls:
  "Stop": bool
panel indicators:
  "RX data": f64[]
  "error out": error
  "loop iteration_2": i32
  "TX Data": f64
uses:
  NI::G Core::Error::Display Error.gvi
  NI::G Core::Error::Filter Error Codes.gvi
  NI::G Core::Error::Filter Error Code.gvi
diagram:
  Tcp Create Listener(port=6340, timeout ms=30000) -> (error out=w1, listener ID=w2)
  Tcp Wait On Listener(error in=w1, listener ID in=w2, timeout ms=30000) -> (connection ID=w3, error out=w4, listener ID out=w5)
  w6 = 61558  # remote port
  w7 = "localhost"  # address
  String To Ip Address(name=w7) -> (net address=w8)
  w9 = 61556  # local port
  Udp Open(port=w9) -> (connection ID=w10, error out=w11)  # UDP Open Connection
  while {
    # TCP Client Loop
    Tcp Read Binary(bytes to read=404, connection ID=w3, error in=w4, mode="Standard", timeout ms=-1) -> (connection ID out=w12, data out=w13, error out=w14)
    Udp Write Binary(address=w8, connection ID=w10, data in=w13, error in=w11, port or service name=w6, timeout ms=25000) -> (connection ID out=w15, error out=w16)
    Unflatten From Byte Array(data bytes=w13, type=f64[] []) -> (error out=w17, value=w18)
    $"RX data" <- w18
    $"error out" <- w17
    Wait(time to wait=100)
    stop if $Stop
  }
  Udp Close(connection ID=w15, error in=w16) -> (error out=w19)  # UDP Close Connection
  call "Display Error.gvi"(error in=w19)
  Tcp Close Connection(connection ID=w5, error in=w4)
  Tcp Write(connection ID=w12, data in="Q", error in=w14) -> (connection ID out=w20, error out=w21)
  Tcp Close Connection(connection ID=w20, error in=w21) -> (error out=w22)
  call "Filter Error Codes.gvi"(error in=w22, codes to clear=[62, 64, 66]) -> (error out=w23, error cleared?=w24)
  call "Display Error.gvi"(error in=w23)
  case (w24) {
    frame False { }
    frame True {
      # Client Closed
      One Button Dialog(message="The server closed the connection.")
    }
  }
  w25 = 61557  # receiver port
  Udp Open(port=w25) -> (connection ID=w26, error out=w27)  # UDP Open Connection
  while (iteration -> i1) {
    Udp Read Binary(connection ID=w26, error in=w27, timeout ms=-1) -> (connection ID out=w28, data out=w29, error out=w30)  # UDP Read Binary (U32 Address)
    Tcp Write Binary(connection ID=w3, data in=w29, error in=w27, timeout ms=-1) -> (error out=w31)
    call "Filter Error Code.gvi"(code to clear=56, error in=w31) -> (error out=w32)
    Merge Errors(w32, w30) -> (error out=w33)
    Unflatten From Byte Array(data bytes=w29, type=f64 0) -> (value=w34)
    $"TX Data" <- w34
    $"loop iteration_2" <- i1
    stop if $Stop
  }
  Udp Close(connection ID=w28, error in=w33) -> (error out=w35)  # UDP Close Connection
  call "Display Error.gvi"(error in=w35)
