vi "Simple TCP - Client.gvi"   [LabVIEW NXG 3.1.0]
panel controls:
  "Stop": bool
panel indicators:
  "Waveform Graph": f64[]
uses:
  NI::G Core::Error::Filter Error Codes.gvi
  NI::G Core::Error::Display Error.gvi
diagram:
  # Certain error codes can occur if the server closes the connection. In these cases, ignore the potential errors that can occur, and instead pop up a dialog indicating that the server closed the connection.
  # Open a TCP connection with the TCP Open Connection node. Note that the port must match the one specified in Simple TCP - Server.gvi.
  Tcp Open Connection(address="localhost", remote port or service name=6340) -> (connection ID=w1, error out=w2)
  # Use TCP Write to send a single character to the server to indicate that the client has stopped. TCP Close Connection closes the connection when the user clicks Stop or an error occurs.
  # Read the data on the specified connection. The first TCP Read node acquires the size of the data, and the second TCP
  # Read node reads the data itself if the size of the data (specified by the server) is greater than zero.
  while {
    Wait(time to wait=100)
    # TCP Client Loop
    Tcp Read Binary(bytes to read=i32 4, connection ID=w1, error in=w2, timeout ms=1000) -> (connection ID out=w3, data out=w4, error out=w5)
    Unflatten From Byte Array(data bytes=w4, error in=w5, type=i32 4) -> (error out=w6, value=w7)
    case (w7) {
      frame 0 {
        # The server has not written any data
        w8 = w3
        w9 = w6
      }
      frame Default {
        Tcp Read Binary(bytes to read=w7, connection ID=w3, error in=w6) -> (connection ID out=w8, data out=w10, error out=w9)
        Unflatten From Byte Array(data bytes=w10, type=f64[] []) -> (value=w11)
        $"Waveform Graph" <- w11
      }
    }
    Logical Or(w9, $Stop) -> w12
    stop if w12
  }
  Tcp Write(connection ID=w8, data in="Q", error in=w9) -> (connection ID out=w13, error out=w14)
  Tcp Close Connection(connection ID=w13, error in=w14) -> (error out=w15)
  call "Filter Error Codes.gvi"(error in=w15, codes to clear=[62, 64, 66]) -> (error out=w16, error cleared?=w17)
  call "Display Error.gvi"(error in=w16)
  case (w17) {
    frame False { }
    frame True {
      # Client Closed
      One Button Dialog(message="The server closed the connection.")
    }
  }
