vi "Channel.gvi"   [LabVIEW NXG 3.1.0]
panel controls:
  "Stop": bool
panel indicators:
  "Received Data": f64
uses:
  NI::G Core::Error::Filter Error Code.gvi
  NI::G Core::Error::Display Error.gvi
diagram:
  w1 = 61557  # remote port
  w2 = 61558  # receiver port
  Udp Open(port=w2) -> (connection ID=w3, error out=w4)  # UDP Open Connection
  w5 = "localhost"  # address
  String To Ip Address(name=w5) -> (net address=w6)
  # Use the UDP Open Connection node to connect to the specified receiver port.
  # Use the UDP Read node to receive the data from the Simple UDP - Sender.gvi.
  while {
    Udp Read(connection ID=w3, error in=w4, timeout ms=100) -> (connection ID out=w7, data out=w8, error out=w9)
    case (w9) {
      frame Error {
        # Sender did not send data. Ignore error 56 (timeout) and keep waiting.
        call "Filter Error Code.gvi"(code to clear=56, error in=w9) -> (error out=w10)
      }
      frame No Error {
        # Sender sent data. Update the chart value.
        Floating Point String To Number(string=w8) -> (number=w11)
        $"Received Data" <- w11
        Number To Fractional String(number=w11) -> (F-format string=w12)
        Udp Write(address=w6, connection ID=w7, data in=w12, error in=w9, port or service name=w1) -> (error out=w10)
      }
    }
    Logical Or(w10, $Stop) -> w13
    stop if w13
  }
  Udp Close(connection ID=w7, error in=w10) -> (error out=w14)  # UDP Close Connection
  # UDP Close Connection closes the connection when the user clicks Stop or an error occurs.
  call "Display Error.gvi"(error in=w14)
