vi "Simple UDP - Sender.gvi"   [LabVIEW NXG 3.1.0]
panel controls:
  "Stop": bool
panel indicators:
  "Current Data Value": f64
  "TX Data": f64
uses:
  NI::G Core::Error::Display Error.gvi
diagram:
  # To broadcast the UDP messages to
  # the entire network, specify an address
  # of 255.255.255.255.
  w1 = 61557  # remote port
  w2 = "10.186.110.40"  # address
  String To Ip Address(name=w2) -> (net address=w3)
  w4 = 61555  # local port
  Udp Open(port=w4) -> (connection ID=w5, error out=w6)  # UDP Open Connection
  # Use the UDP Open Connection node to create a UDP connection on the specified port.
  # The UDP Write node sends data (as a string data type) to the specified remote port.
  # The value is written to the port regardless of whether or not a receiver is currently connected.
  while {
    Wait(time to wait=500)
    Random Number() -> (number (0 to 1)=w7)
    $"TX Data" <- w7
    $"Current Data Value" <- w7
    Flatten To Byte Array(anything=w7) -> (data bytes=w8)
    Udp Write Binary(address=w3, connection ID=w5, data in=w8, error in=w6, port or service name=w1) -> (connection ID out=w9, error out=w10)
    Logical Or(w10, $Stop) -> w11
    stop if w11
  }
  Udp Close(connection ID=w9, error in=w10) -> (error out=w12)  # UDP Close Connection
  # The UDP Close Connection node closes the
  # connection when the user clicks
  # Stop or an error occurs.
  call "Display Error.gvi"(error in=w12)
