vi "udp_transmission.gvi"   [LabVIEW NXG 3.1.0]
panel indicators:
  "data out": u8[]
  "actual port": u16
  "element": u8[]
diagram:
  # S-2: udp port where payload will come
  # udp_transmission.gvi version 1.1
  # This gvi is used for udp transmission of video as well as iperf tests
  # Author: Sumit Kumar
  # SnT
  # Date: 5 Sept 2019
  # S-1: IP of system where UDP payload is generated, i.e., System-A
  String To Ip Address(name="10.186.110.22") -> (net address=w1)
  Udp Open(net address=w1, port=50001, timeout ms=100) -> (actual port=w2, connection ID=w3, error out=w4)
  $"actual port" <- w2
  Obtain Queue(create if not found=TRUE, element data type=u8[1] [0], max queue size=-1) -> (queue out=w5)
  while {
    Udp Read I Pv 6 Binary(connection ID=w3, error in=w4, max size=4061) -> (data out=w6)
    $"data out" <- w6
    Enqueue Element(element=w6, queue=w5) -> (queue out=w7, timed out?=w8)
    stop if w8
  }
  Release Queue(queue=w7)
  # S-4: port of udp on the remote system where the client can listen
  # S-3: IP of system-B, i.e., destination of UDP transmission
  String To Ip Address(name="10.186.110.41") -> (net address=w9)
  # S-5: same as S-1
  String To Ip Address(name="10.186.110.22") -> (net address=w10)
  # S-6: any port number we put here, insignificant
  Udp Open(net address=w10, port=50003) -> (connection ID=w11)
  while {
    Dequeue Element(queue=w5) -> (element=w12, timed out?=w13)
    Udp Write Binary(address=w9, connection ID=w11, data in=w12, port or service name=50002)
    $element <- w12
    stop if w13
  }
